% Simulink data dictionary VF.sldd

Pn = Simulink.Parameter(4, StorageClass="Struct", StructName="Motor", DataType="single")
Rs = Simulink.Parameter(0.23, StorageClass="Struct", StructName="Motor", DataType="single")
L = Simulink.Parameter(8.0e-5, StorageClass="Struct", StructName="Motor", DataType="single")
Ke = Simulink.Parameter(3.59, StorageClass="Struct", StructName="Motor", DataType="single")
Udc = Simulink.Parameter(24, DataType="single")