% Simulink data dictionary Speedloop.sldd

Pn = Simulink.Parameter(4, StorageClass="Struct", StructName="Motor", DataType="single")
Rs = Simulink.Parameter(0.23, StorageClass="Struct", StructName="Motor", DataType="single")
L = Simulink.Parameter(8.0e-5, StorageClass="Struct", StructName="Motor", DataType="single")
Ke = Simulink.Parameter(3.59, StorageClass="Struct", StructName="Motor", DataType="single")
Udc = Simulink.Parameter(24, DataType="single")
SpeedFd = Simulink.Signal(StorageClass="ExportedGlobal", DataType="single")
Motor_state = Simulink.Signal(StorageClass="ExportedGlobal", DataType="single")
curr_ki = Simulink.Parameter(2.3, StorageClass="Struct", StructName="currkpki", DataType="single")
curr_kp = Simulink.Parameter(0.0008, StorageClass="Struct", StructName="currkpki", DataType="single")
spd_ki = Simulink.Parameter(0.021, StorageClass="Struct", StructName="spdkpki", DataType="single")
spd_kp = Simulink.Parameter(0.013, StorageClass="Struct", StructName="spdkpki", DataType="single")